vi "Main_GUI.gvi"   [LabVIEW NXG 5.0.0]
# -> All the controllers have an ON/OFF switch which turns from RED to GREEN for the controller to be enabled.
# -> A control parameter can can be easility identified by Setpoint in the label of the textbox of the WHITE backbround of the textbox. (Note: A grey background indicates an indicator or measured valued.)
# -> The complete setup is based on Arduino and arduino based components, hence, the core functions are written in Arduino IDE using its native language which is based on C++.
# -> For detailed description of circuits, modules, program flow, functions, variables and all possible serial commands please visit the Ardino code file in the Links folder in the file tree.
# -> The specific Arduino board used for this application is Arduino Mega 2560.
# -> The software package used to write the native Arduino code is Ardino Pro IDE Alpha Version 0.1.3 - nightly.20201217 and the GUI is developed in LabVIEW NXG 5.0.
panel controls:
  "Setpoint MFC#1": f64
  "Process Gas": string
  "Setpoint MFC#2": f64
  "Setpoint MFC#3": f64
  "Setpoint MFC#4": f64
  "Process Gas": string
  "Process Gas": string
  "Process Gas": string
  "Setpoint MFC#5": f64
  "Process Gas": string
  "Setpoint BPR-1": f64
  "Initialise Controls": bool
  "Tab": i32
  "Tab_2": i32
  "Factory Calibration Gas MFC#1": string = "1.00"
  "Full Scale Range (Factory Calibrated Gas) MFC#1": f64 = 1000
  "Vmax @100% Detection Limit MFC#1": f64 = 5
  "Vmin @0% Detection Limit MFC#1": f64
  "Process Gas MFC#1": string = "1.0"
  "Factory Calibration Gas MFC#2": string = "0.72"
  "Full Scale Range (Factory Calibrated Gas) MFC#2": f64 = 100
  "Vmax @100% Detection Limit MFC#2": f64 = 5
  "Vmin @0% Detection Limit MFC#2": f64
  "Process Gas MFC#2": string = "1.39"
  "Factory Calibration Gas MFC#3": string = "0.73"
  "Full Scale Range (Factory Calibrated Gas) MFC#3": f64 = 100
  "Vmax @100% Detection Limit MFC#3": f64 = 5
  "Vmin @0% Detection Limit MFC#3": f64
  "Process Gas MFC#3": string = "0.73"
  "Factory Calibration Gas MFC#4": string = "1.01"
  "Full Scale Range (Factory Calibrated Gas) MFC#4": f64 = 10000
  "Vmax @100% Detection Limit MFC#4": f64 = 5
  "Vmin @0% Detection Limit MFC#4": f64
  "Process Gas MFC#4": string = "1.01"
  "Factory Calibration Gas MFC#5": string = "0.73"
  "Full Scale Range (Factory Calibrated Gas) MFC#5": f64 = 1000
  "Vmax @100% Detection Limit MFC#5": f64 = 5
  "Vmin @0% Detection Limit MFC#5": f64
  "Process Gas MFC#5": string = "0.73"
  "Factory Calibration Gas MFM#1": string = "0.73"
  "Full Scale Range (Factory Calibrated Gas) MFM#1": f64 = 1000
  "Vmax @100% Detection Limit MFM#1": f64 = 5
  "Vmin @0% Detection Limit MFM#1": f64 = 1
  "Process Gas MFM#1": string = "1.0"
  "Factory Calibration Gas MFM#2": string = "1.0"
  "Full Scale Range (Factory Calibrated Gas) MFM#2": f64 = 1000
  "Vmax @100% Detection Limit MFM#2": f64 = 5
  "Vmin @0% Detection Limit MFM#2": f64
  "Process Gas MFM#2": string = "1.0"
  "Vmax @100% Detection Limit PT#1": f64 = 5
  "Vmin @0% Detection Limit PT#1": f64 = 1
  "Full Scale Detection Range PT#1": f64 = 500
  "Vmax @100% Detection Limit PT#2": f64 = 5
  "Vmin @0% Detection Limit PT#2": f64 = 1
  "Full Scale Detection Range PT#2": f64 = 600
  "Vmax @100% Detection Limit BPR#1": f64 = 10
  "Vmin @0% Detection Limit BPR#1": f64
  "Full Scale Detection Range BPR#1": f64 = 500
  "Vmax @100% Detection Limit NDIR": f64 = 5
  "Vmin @0% Detection Limit NDIR": f64 = 1
  "Full Scale Detection Range NDIR": f64 = 20000
  "Vmax @100% Detection Limit ppbLAD": f64 = 5
  "Vmin @0% Detection Limit ppbLAD": f64 = 1
  "Full Scale Detection Range ppbLAB": f64 = 40
  "Load Configuration": bool
  "Switch MFC#1": bool
  "Switch MFC#2": bool
  "Switch MFC#3": bool
  "Switch MFC#4": bool
  "Switch MFC#5": bool
  "Switch BPR#1": bool
  "Ammoia Cylinder Heating Jacket": bool
  "HP NH3 Delivery System Tubing": bool
  "HP-HT Mass Flow Controller": bool
  "Not Connected Yet": bool
  "Zero Offsets": bool
  "Tab_3": i32
  "Capture Data": bool
  "Select Event for Data Collection": enum{"0", "1", "2"} = "0"
panel indicators:
  "Reading MFC#1": f64
  "Maximum Flow": f64
  "Reading MFC#2": f64
  "Maximum Flow": f64
  "Reading MFC#3": f64
  "Maximum Flow": f64
  "Reading MFC#4": f64
  "Maximum Flow": f64
  "TC-1": f64
  "TC-2": f64
  "TC-4": f64
  "TC-3": f64
  "PT-1": f64
  "TC-6": f64
  "TC-7": f64
  "TC-5": f64
  "Reading MFC#5": f64
  "Maximum Flow": f64
  "PT-2": f64
  "BPR_1": f64
  "MFM-1": f64
  "MFM-2": f64
  "NDIR Ammonia Concentration": f64
  "Gas Calibration Factor in Use": f64
  "ppb Ammonia Concentration": f64
  "Full Scale Range (Process Gas) MFC#1": f64
  "Scaling Factor MFC#1": f64
  "Offset @No Signal MFC#1": f64
  "Full Scale Range (Process Gas) MFC#2": f64
  "Scaling Factor MFC#2": f64
  "Offset @No Signal MFC#2": f64
  "Full Scale Range (Process Gas) MFC#3": f64
  "Scaling Factor MFC#3": f64
  "Offset @No Signal MFC#3": f64
  "Full Scale Range (Process Gas) MFC#4": f64
  "Scaling Factor MFC#4": f64
  "Offset @No Signal MFC#4": f64
  "Full Scale Range (Process Gas) MFC#5": f64
  "Scaling Factor MFC#5": f64
  "Offset @No Signal MFC#5": f64
  "Full Scale Range (Process Gas) MFM#1": f64
  "Scaling Factor MFM#1": f64
  "Offset @No Signal MFM#1": f64
  "Full Scale Range (Process Gas) MFM#2": f64
  "Scaling Factor MFM#2": f64
  "Offset @No Signal MFM#2": f64
  "Scaling Factor PT#1": f64
  "Scaling Factor PT#2": f64
  "Scaling Factor BPR#1": f64
  "Scaling Factor NDIR": f64
  "Scaling Factor ppbLAD": f64
  "Offset @No Signal PT#1": f64
  "Offset @No Signal PT#2": f64
  "Offset @No Signal BPR#1": f64
  "Offset @ 0 ppm Ammonia Concentration": f64
  "Offset @ 0 ppm Ammonia Concentration (ppbLAD)": f64
  "Mass Flow Rate": f64[]
  "Pressure": f64[]
  "Temperature": f64[]
  "GC Compositition": f64
  "Ammonia Permeance Test": string[][]
  "loop iteration": i32
uses:
  NI::VISA::Configure Serial Port (Instr).gvi
  NI::VISA::Open (Instr).gvi
  NI::VISA::Close (Instr).gvi
diagram:
  # N2 Permeance/Leak Testing
  Concatenate Strings("Date", "\t", "Time", "\t", "Run Time (hr)", "\t", "Pressure (psi)", "\t", "Temperature (C)", "\t", "N2 Flow Rate (sccm)", "\t", "Permate Flow Rate (sccm)", "\r\n") -> w1
  call "Configure Serial Port (Instr).gvi"(stop bits="1.0"(10), session in="COM7", termination char=0x3B) -> (session out=w2, error out=w3)
  call "Open (Instr).gvi"(resource name=w2, error in=w3) -> (session out=w4, error out=w5)
  # CMR Performance Testing
  Concatenate Strings("Date", "\t", "Time", "\t", "Run Time (hr)", "\t", "Pressure (psi)", "\t", "Temperature (C)", "\t", "NH3 Mass Flow Rate (sccm)", "\t", "Retentate Mass Flow Rate (sccm)", "\t", "Permate Mass Flow Rate (sccm)", "\t", "GC - N2 Mol Frac", "\t", "GC - NH3 Mol Frac", "\t", "GC - H2 Mol Frac", "\t", "NDIR - NH3 Conc. (ppm)", "\r\n") -> w6
  # H2 Permeance Testing
  Concatenate Strings("Date", "\t", "Time", "\t", "Run Time (hr)", "\t", "Pressure (psi)", "\t", "Temperature (C)", "\t", "N2 Flow Rate (sccm)", "\t", "Permate Flow Rate (sccm)", "\r\n") -> w7
  Get Current Time() -> (current time=w8)
  s1 = w1  # shift register
  s2 = w7  # shift register
  s3 = w6  # shift register
  while (iteration -> i1) {
    sequence {
      frame 0 {
        Select(s=$"Zero Offsets", t=TRUE, f=FALSE) -> w9
        case (w9) {
          frame False, Default {
            w10 = w5
            w11 = default
            w12 = default
            w13 = default
            w14 = default
            w15 = default
            w16 = default
            w17 = default
            w18 = default
            w19 = default
            w20 = default
            w21 = default
            w22 = default
            w23 = w4
          }
          frame True {
            call "Serial_Read.gvi"(session in=w4, error in=w5, INST_Code_Sr#="MFC01") -> (session out=w24, error out=w25, Serial Output=w11)
            call "Serial_Read.gvi"(session in=w24, error in=w25, INST_Code_Sr#="MFC02") -> (session out=w26, error out=w27, Serial Output=w12)
            call "Serial_Read.gvi"(session in=w26, error in=w27, INST_Code_Sr#="MFC03") -> (session out=w28, error out=w29, Serial Output=w13)
            call "Serial_Read.gvi"(session in=w28, error in=w29, INST_Code_Sr#="MFC04") -> (session out=w30, error out=w31, Serial Output=w14)
            call "Serial_Read.gvi"(session in=w30, error in=w31, INST_Code_Sr#="MFC05") -> (session out=w32, error out=w33, Serial Output=w15)
            call "Serial_Read.gvi"(session in=w32, error in=w33, INST_Code_Sr#="BPR01") -> (session out=w34, error out=w35, Serial Output=w16)
            call "Serial_Read.gvi"(session in=w34, error in=w35, INST_Code_Sr#="ADC11") -> (session out=w36, error out=w37, Serial Output=w17)
            call "Serial_Read.gvi"(session in=w36, error in=w37, INST_Code_Sr#="ADC12") -> (session out=w38, error out=w39, Serial Output=w18)
            call "Serial_Read.gvi"(session in=w38, error in=w39, INST_Code_Sr#="ADC21") -> (session out=w40, error out=w41, Serial Output=w19)
            call "Serial_Read.gvi"(session in=w40, error in=w41, INST_Code_Sr#="ADC22") -> (session out=w42, error out=w43, Serial Output=w20)
            call "Serial_Read.gvi"(session in=w42, error in=w43, INST_Code_Sr#="ADC31") -> (session out=w44, error out=w45, Serial Output=w21)
            call "Serial_Read.gvi"(session in=w44, error in=w45, INST_Code_Sr#="ADC32") -> (session out=w23, error out=w10, Serial Output=w22)
          }
        }
      }
      frame 1 {
        Logical Or($"Initialise Controls", $"Load Configuration") -> w46
        Select(s=w46, t=TRUE, f=FALSE) -> w47
        case (w47) {
          frame False, Default {
            w48 = default
            w49 = default
            w50 = default
            w51 = default
            w52 = default
            w53 = default
            w54 = default
            w55 = default
            w56 = default
            w57 = default
            w58 = default
            w59 = default
            w60 = default
            w61 = default
            w62 = default
            w63 = default
            w64 = default
          }
          frame True {
            call "Mass_Flow.gvi"(Factory Calibration Gas=$"Factory Calibration Gas MFC#1", Process Gas=$"Process Gas", Full Scale Range (Factory Calibrated Gas)=$"Full Scale Range (Factory Calibrated Gas) MFC#1", Vmax @100% detection limit=$"Vmax @100% Detection Limit MFC#1", Vmin @0% detection limit=$"Vmin @0% Detection Limit MFC#1") -> (Full Scale Range (Process Gas)=w51, Scaling Factor=w52)
            $"Full Scale Range (Process Gas) MFC#1" <- w51
            $"Scaling Factor MFC#1" <- w52
            # Back Pressure Regulator Scaling Factor
            call "Mass_Flow.gvi"(Factory Calibration Gas=$"Factory Calibration Gas MFC#2", Process Gas=$"Process Gas", Full Scale Range (Factory Calibrated Gas)=$"Full Scale Range (Factory Calibrated Gas) MFC#2", Vmax @100% detection limit=$"Vmax @100% Detection Limit MFC#2", Vmin @0% detection limit=$"Vmin @0% Detection Limit MFC#2") -> (Full Scale Range (Process Gas)=w48, Scaling Factor=w53)
            $"Full Scale Range (Process Gas) MFC#2" <- w48
            $"Scaling Factor MFC#2" <- w53
            call "Mass_Flow.gvi"(Factory Calibration Gas=$"Factory Calibration Gas MFC#3", Process Gas=$"Process Gas", Full Scale Range (Factory Calibrated Gas)=$"Full Scale Range (Factory Calibrated Gas) MFC#3", Vmax @100% detection limit=$"Vmax @100% Detection Limit MFC#3", Vmin @0% detection limit=$"Vmin @0% Detection Limit MFC#3") -> (Full Scale Range (Process Gas)=w50, Scaling Factor=w55)
            $"Full Scale Range (Process Gas) MFC#3" <- w50
            $"Scaling Factor MFC#3" <- w55
            call "Mass_Flow.gvi"(Factory Calibration Gas=$"Factory Calibration Gas MFC#4", Process Gas=$"Process Gas", Full Scale Range (Factory Calibrated Gas)=$"Full Scale Range (Factory Calibrated Gas) MFC#4", Vmax @100% detection limit=$"Vmax @100% Detection Limit MFC#4", Vmin @0% detection limit=$"Vmin @0% Detection Limit MFC#4") -> (Full Scale Range (Process Gas)=w49, Scaling Factor=w56)
            $"Full Scale Range (Process Gas) MFC#4" <- w49
            $"Scaling Factor MFC#4" <- w56
            call "Mass_Flow.gvi"(Factory Calibration Gas=$"Factory Calibration Gas MFC#5", Process Gas=$"Process Gas", Full Scale Range (Factory Calibrated Gas)=$"Full Scale Range (Factory Calibrated Gas) MFC#5", Vmax @100% detection limit=$"Vmax @100% Detection Limit MFC#5", Vmin @0% detection limit=$"Vmin @0% Detection Limit MFC#5") -> (Full Scale Range (Process Gas)=w54, Scaling Factor=w57)
            $"Full Scale Range (Process Gas) MFC#5" <- w54
            $"Scaling Factor MFC#5" <- w57
            Subtract(x=$"Vmax @100% Detection Limit ppbLAD", y=$"Vmin @0% Detection Limit ppbLAD") -> w65
            Divide(x=$"Full Scale Detection Range ppbLAB", y=w65) -> w64
            $"Scaling Factor ppbLAD" <- w64
            call "Mass_Flow.gvi"(Factory Calibration Gas=$"Factory Calibration Gas MFM#2", Process Gas=$"Process Gas MFM#2", Full Scale Range (Factory Calibrated Gas)=$"Full Scale Range (Factory Calibrated Gas) MFM#2", Vmax @100% detection limit=$"Vmax @100% Detection Limit MFM#2", Vmin @0% detection limit=$"Vmin @0% Detection Limit MFM#2") -> (Full Scale Range (Process Gas)=w66, Scaling Factor=w60)
            $"Full Scale Range (Process Gas) MFM#1" <- w66
            $"Scaling Factor MFM#1" <- w60
            call "Mass_Flow.gvi"(Factory Calibration Gas=$"Factory Calibration Gas MFM#1", Process Gas=$"Process Gas MFM#1", Full Scale Range (Factory Calibrated Gas)=$"Full Scale Range (Factory Calibrated Gas) MFM#1", Vmax @100% detection limit=$"Vmax @100% Detection Limit MFM#1", Vmin @0% detection limit=$"Vmin @0% Detection Limit MFM#1") -> (Full Scale Range (Process Gas)=w67, Scaling Factor=w59)
            $"Full Scale Range (Process Gas) MFM#2" <- w67
            $"Scaling Factor MFM#2" <- w59
            Subtract(x=$"Vmax @100% Detection Limit NDIR", y=$"Vmin @0% Detection Limit NDIR") -> w68
            Divide(x=$"Full Scale Detection Range NDIR", y=w68) -> w61
            $"Scaling Factor NDIR" <- w61
            Subtract(x=$"Vmax @100% Detection Limit PT#1", y=$"Vmin @0% Detection Limit PT#1") -> w69
            Divide(x=$"Full Scale Detection Range PT#1", y=w69) -> w63
            $"Scaling Factor PT#1" <- w63
            Subtract(x=$"Vmax @100% Detection Limit BPR#1", y=$"Vmin @0% Detection Limit BPR#1") -> w70
            Divide(x=$"Full Scale Detection Range BPR#1", y=w70) -> w58
            $"Scaling Factor BPR#1" <- w58
            Subtract(x=$"Vmax @100% Detection Limit PT#2", y=$"Vmin @0% Detection Limit PT#2") -> w71
            Divide(x=$"Full Scale Detection Range PT#2", y=w71) -> w62
            $"Scaling Factor PT#2" <- w62
          }
        }
      }
    }
    call "Serial_Read.gvi"(session in=w23, error in=w10, INST_Code_Sr#="MFC01") -> (session out=w72, error out=w73, Serial Output=w74)
    Subtract(x=w74, y=w11) -> w75
    Multiply(w75, w52) -> w76
    $"Reading MFC#1" <- w76
    call "Serial_Read.gvi"(session in=w72, error in=w73, INST_Code_Sr#="MFC02") -> (session out=w77, error out=w78, Serial Output=w79)
    Subtract(x=w79, y=w12) -> w80
    Multiply(w80, w53) -> w81
    $"Reading MFC#2" <- w81
    $"Maximum Flow" <- w51
    call "Serial_Read.gvi"(session in=w77, error in=w78, INST_Code_Sr#="MFC03") -> (session out=w82, error out=w83, Serial Output=w84)
    Subtract(x=w84, y=w13) -> w85
    Multiply(w85, w55) -> w86
    call "Serial_Read.gvi"(session in=w82, error in=w83, INST_Code_Sr#="MFC04") -> (session out=w87, error out=w88, Serial Output=w89)
    Subtract(x=w89, y=w14) -> w90
    Multiply(w90, w56) -> w91
    call "Serial_Read.gvi"(session in=w87, error in=w88, INST_Code_Sr#="MFC05") -> (session out=w92, error out=w93, Serial Output=w94)
    Subtract(x=w94, y=w15) -> w95
    Multiply(w95, w57) -> w96
    call "Serial_Read.gvi"(session in=w92, error in=w93, INST_Code_Sr#="BPR01") -> (session out=w97, error out=w98, Serial Output=w99)
    call "Serial_Read.gvi"(session in=w97, error in=w98, INST_Code_Sr#="ADC11") -> (session out=w100, error out=w101, Serial Output=w102)
    Subtract(x=w102, y=w17) -> w103
    Multiply(w103, w59) -> w104
    call "Serial_Read.gvi"(session in=w100, error in=w101, INST_Code_Sr#="ADC12") -> (session out=w105, error out=w106, Serial Output=w107)
    Subtract(x=w107, y=w18) -> w108
    Multiply(w108, w60) -> w109
    Build Array(w76, w81, w86, w91, w96, w104, w109) -> w110
    call "Serial_Read.gvi"(session in=w105, error in=w106, INST_Code_Sr#="ADC21") -> (session out=w111, error out=w112, Serial Output=w113)
    call "Serial_Read.gvi"(session in=w111, error in=w112, INST_Code_Sr#="ADC22") -> (session out=w114, error out=w115, Serial Output=w116)
    call "Serial_Read.gvi"(session in=w114, error in=w115, INST_Code_Sr#="ADC31") -> (session out=w117, error out=w118, Serial Output=w119)
    Subtract(x=w119, y=w21) -> w120
    Multiply(w120, w61) -> w121
    Get Current Time() -> (current time=w122)
    Get Date And Time String(time stamp=w122, want seconds? (F)=TRUE) -> (date string=w123, time string=w124)
    Array Index(array=w110) -> (out0[6]=w125)
    Subtract(x=w99, y=w16) -> w126
    Multiply(w126, w58) -> w127
    Subtract(x=w113, y=w19) -> w128
    Multiply(w128, w63) -> w129
    Subtract(x=w116, y=w20) -> w130
    Multiply(w130, w62) -> w131
    Build Array(w129, w131, w127) -> w132
    Array Index(array=w132) -> (out0[1]=w133)
    call "Serial_Read.gvi"(session in=w117, error in=w118, INST_Code_Sr#="ADC32") -> (session out=w134, error out=w135, Serial Output=w136)
    call "Serial_Read.gvi"(session in=w134, error in=w135, INST_Code_Sr#="_TC03") -> (session out=w137, error out=w138, Serial Output=w139)
    call "Serial_Read.gvi"(session in=w137, error in=w138, INST_Code_Sr#="_TC03") -> (session out=w140, error out=w141, Serial Output=w142)
    call "Serial_Read.gvi"(session in=w140, error in=w141, INST_Code_Sr#="_TC03") -> (session out=w143, error out=w144, Serial Output=w145)
    call "Serial_Read.gvi"(session in=w143, error in=w144, INST_Code_Sr#="_TC04") -> (session out=w146, error out=w147, Serial Output=w148)
    call "Serial_Read.gvi"(session in=w146, error in=w147, INST_Code_Sr#="_TC03") -> (session out=w149, error out=w150, Serial Output=w151)
    call "Serial_Read.gvi"(session in=w149, error in=w150, INST_Code_Sr#="_TC06") -> (session out=w152, error out=w153, Serial Output=w154)
    call "Serial_Read.gvi"(session in=w152, error in=w153, INST_Code_Sr#="_TC07") -> (session out=w155, error out=w156, Serial Output=w157)
    Build Array(w139, w142, w145, w148, w151, w154, w157) -> w158
    Array Index(array=w158) -> (out0[6]=w159)
    Timestamp Subtract(x=w122, y=w8) -> w160
    Divide(x=w160, y=3600) -> w161
    case ($"Capture Data") {
      frame False, Default {
        w162 = s1
        w163 = s2
        w164 = s3
      }
      frame True {
        Number To Fractional String(number=w161) -> (F-format string=w165)
        Number To Fractional String(number=w133) -> (F-format string=w166)
        Number To Fractional String(number=w159) -> (F-format string=w167)
        Number To Fractional String(number=w125) -> (F-format string=w168)
        Number To Fractional String(number=w121) -> (F-format string=w169)
        case ($"Select Event for Data Collection") {
          frame "0" {
            Array Index(array=w110) -> (out0[1]=w170)
            Number To Fractional String(number=w170) -> (F-format string=w171)
            Concatenate Strings(w123, "\t", w124, "\t", w165, "\t", w166, "\t", w167, "\t", w171, "\t", w168, "\r\n") -> w172
            Concatenate Strings(s1, w172) -> w162
            w163 = s2
            w164 = s3
          }
          frame "1" {
            Array Index(array=w110) -> (out0[3]=w173)
            Number To Fractional String(number=w173) -> (F-format string=w174)
            Concatenate Strings(w123, "\t", w124, "\t", w165, "\t", w166, "\t", w167, "\t", w174, "\t", w168, "\r\n") -> w175
            Concatenate Strings(s2, w175) -> w163
            w162 = s1
            w164 = s3
          }
          frame "2", Default {
            Select(s=$"Switch MFC#5", t=4, f=2) -> w176
            Array Index(array=w110) -> (out0[w176]=w177)
            Number To Fractional String(number=w177) -> (F-format string=w178)
            Array Index(array=w110) -> (out0[5]=w179)
            Number To Fractional String(number=w179) -> (F-format string=w180)
            call "Get_GC_Composition.gvi"(Sequence Data Folder Path=path "\\ADMIN-CMR-GC\\CMRTest_HighPressure") -> (Nitrogen Concentration from GC=w181, Ammonia Concentation from GC=w182, Hydrogen Concentration from GC=w183)
            Number To Fractional String(number=w181) -> (F-format string=w184)
            Number To Fractional String(number=w182) -> (F-format string=w185)
            Number To Fractional String(number=w183) -> (F-format string=w186)
            Concatenate Strings(w123, "\t", w124, "\t", w165, "\t", w166, "\t", w167, "\t", w178, "\t", w180, "\t", w168, "\t", w184, "\t", w185, "\t", w186, "\t", w169, "\r\n") -> w187
            Concatenate Strings(s3, w187) -> w164
            w162 = s1
            w163 = s2
          }
        }
      }
    }
    $"loop iteration" <- i1
    $"Reading MFC#3" <- w86
    $"Offset @No Signal MFC#2" <- w12
    $"Reading MFC#4" <- w91
    $"Offset @No Signal MFC#1" <- w11
    $"Maximum Flow" <- w48
    $"Reading MFC#5" <- w96
    $"Offset @No Signal MFC#3" <- w13
    Subtract(x=w136, y=w22) -> w188
    Multiply(w188, w64) -> w189
    $"ppb Ammonia Concentration" <- w189
    $"Maximum Flow" <- w50
    $"Offset @No Signal MFC#4" <- w14
    $"Mass Flow Rate" <- w110
    $"Maximum Flow" <- w49
    $Pressure <- w132
    $"NDIR Ammonia Concentration" <- w121
    $"Offset @No Signal MFC#5" <- w15
    $Temperature <- w158
    $"Maximum Flow" <- w54
    $"Offset @ 0 ppm Ammonia Concentration (ppbLAD)" <- w22
    $"Offset @ 0 ppm Ammonia Concentration" <- w21
    $"Offset @No Signal MFM#2" <- w18
    $"TC-1" <- w139
    $"Offset @No Signal MFM#1" <- w17
    $"TC-2" <- w142
    $"TC-3" <- w145
    $BPR_1 <- w127
    $"TC-4" <- w148
    $"Offset @No Signal PT#1" <- w19
    $"PT-1" <- w129
    $"TC-5" <- w151
    $"PT-2" <- w131
    $"Offset @No Signal BPR#1" <- w16
    $"MFM-2" <- w109
    $"TC-6" <- w154
    $"TC-7" <- w157
    $"MFM-1" <- w104
    $"Offset @No Signal PT#2" <- w20
    call "Serial_Write.gvi"(session in=w155, error in=w156, INST_Code_Sr#="MFC01", Setpoint=$"Setpoint MFC#1", Switch=$"Switch MFC#1") -> (session out=w190, error out=w191)
    call "Serial_Write.gvi"(session in=w190, error in=w191, INST_Code_Sr#="MFC02", Setpoint=$"Setpoint MFC#2", Switch=$"Switch MFC#2") -> (session out=w192, error out=w193)
    call "Serial_Write.gvi"(session in=w192, error in=w193, INST_Code_Sr#="MFC03", Setpoint=$"Setpoint MFC#3", Switch=$"Switch MFC#3") -> (session out=w194, error out=w195)
    call "Serial_Write.gvi"(session in=w194, error in=w195, INST_Code_Sr#="MFC04", Setpoint=$"Setpoint MFC#4", Switch=$"Switch MFC#4") -> (session out=w196, error out=w197)
    call "Serial_Write.gvi"(session in=w196, error in=w197, INST_Code_Sr#="MFC05", Setpoint=$"Setpoint MFC#5", Switch=$"Switch MFC#5") -> (session out=w198, error out=w199)
    call "Serial_Write.gvi"(session in=w198, error in=w199, INST_Code_Sr#="BPR01", Setpoint=$"Setpoint BPR-1", Switch=$"Switch BPR#1") -> (session out=w200, error out=w201)
    call "Serial_Write_Relay.gvi"(session in=w200, error in=w201, INST_Code_Sr#="RLY01", Switch=$"Ammoia Cylinder Heating Jacket") -> (session out=w202, error out=w203)
    call "Serial_Write_Relay.gvi"(session in=w202, error in=w203, INST_Code_Sr#="RLY02", Switch=$"HP NH3 Delivery System Tubing") -> (session out=w204, error out=w205)
    call "Serial_Write_Relay.gvi"(session in=w204, error in=w205, INST_Code_Sr#="RLY03", Switch=$"HP-HT Mass Flow Controller") -> (session out=w206, error out=w207)
    call "Serial_Write_Relay.gvi"(session in=w206, error in=w207, INST_Code_Sr#="RLY04", Switch=$"Not Connected Yet") -> (session out=w208, error out=w209)
    next s1 = w162
    next s2 = w163
    next s3 = w164
    continue if TRUE
  }
  call "Close (Instr).gvi"(session in=w208, error in=w209)
