vi "Serial_Read.gvi"   [LabVIEW NXG 5.0.0]
inputs:
  "session in": "VISA Instr"
  "error in": error
  "INST_Code_Sr#": string
outputs:
  "session out": "VISA Instr"
  "error out": error
  "Serial Output": f64
uses:
  NI::VISA::Write (Instr, String).gvi
  NI::VISA::Read (Instr, String).gvi
diagram:
  sequence {
    frame 0 {
      Concatenate Strings(":PV", $"INST_Code_Sr#", ";") -> w1
      call "Write (Instr, String).gvi"(session in=$"session in", error in=$"error in", write buffer=w1) -> (session out=w2, error out=w3, return count=w4)
    }
    frame 1 {
      Wait(time to wait=50)
    }
    frame 2 {
      call "Read (Instr, String).gvi"(session in=w2, error in=w3, byte count=w4) -> (session out=w5, error out=w6, read buffer=w7)
      Floating Point String To Number(string=w7) -> (number=w8)
      $"Serial Output" <- w8
    }
    frame 3 {
      Wait(time to wait=50)
      $"session out" <- w5
      $"error out" <- w6
    }
  }
